# Dynamo custom node PipeSplit.dyf (Dynamo 1.3.4.6666)
# category: MEPDesign
# Split pipe by points and lengths

Elements = Input()
Points = Input()
Lengths = Input()
python_script = Python(IN[0]=Elements, IN[1]=Points, IN[2]=Lengths)
# ---------- python_script.python (63 lines) ----------
# Load the Python Standard and DesignScript Libraries
import sys
import clr

# Enable Python support and load DesignScript libraryimport clr
clr.AddReference('ProtoGeometry')
from Autodesk.DesignScript.Geometry import*
 
clr.AddReference('RevitAPI')
clr.AddReference('RevitServices')
# import document manager
from RevitServices.Persistence import DocumentManager
# import transaction manager
from RevitServices.Transactions import TransactionManager
# instantiate current document
doc = DocumentManager.Instance.CurrentDBDocument
from Autodesk.Revit.DB.Plumbing.PlumbingUtils import BreakCurve 
from Autodesk.Revit.DB import XYZ

clr.AddReference("RevitNodes")
import Revit
clr.ImportExtensions(Revit.GeometryConversion)
from Revit import GeometryConversion as gp
# The inputs to this node will be stored as a list in the IN variables.
dataEnteringNode = IN
 
#Get pipes and unwrap
pipes = UnwrapElement(IN[0])
points = IN[1]
distancias = IN[2]



# start transaction

TransactionManager.Instance.EnsureInTransaction(doc)

for t in range(0,len(pipes),1):
	for i in range(0,len(points[t]),1):
	
		if(distancias[t][i]>=0.1):
			
			dbPoint = points[t][i].ToXyz()
			pipe = pipes[t]
			newPipeId = BreakCurve(doc, pipe.Id, dbPoint)
			newPipe = doc.GetElement(newPipeId)	
			
			
			newPipeConnectors = newPipe.ConnectorManager.Connectors
			connA = None
			connB = None
			for c in pipe.ConnectorManager.Connectors:
				pc = c.Origin
				nearest = [x for x in newPipeConnectors if pc.DistanceTo(x.Origin) < 0.01]
				if nearest:
					connA = c
					connB = nearest[0]
			takeoff = doc.Create.NewUnionFitting(connA, connB)
			
		
TransactionManager.Instance.TransactionTaskDone()

OUT = 0
# ----------------------------------------
